# Dynamo graph Creating wall types_script.dyn (Dynamo 2.10.1.3976)
# packages: Orchid 2.6.7.6006, Genius Loci 2021.11.10, Data-Shapes 2022.2.103, Clockwork for Dynamo 1.x 1.34.0

file_path = Filename("..\..\github upload\Family sizes.xlsx")  # graph input
filepath_data = Custom[FilePath Data](DefaulPath=file_path)  # package Data-Shapes; Create filepath input for UI.MultipleInputForm ++ . Check out www.data-shapes.net for more infos !
boolean = BoolSelector(true)
multipleinputform = Custom[MultipleInputForm ++](Inputs=filepath_data, Toggle=boolean)  # package Data-Shapes; Create a form with multiple inputs. see www.data-shapes.net for tutorials and infos!
file_from_path = FileObject(path=multipleinputform.User_Inputs)
string = StringInput("wall")
importExcel = Data.ImportExcel(file=file_from_path, sheetName=string)
equalSublistLengths = Custom[List.EqualSublistLengths](lists=importExcel)  # package Clockwork for Dynamo 1.x; Trims all given lists to the length of the shortest list
code_block = CodeBlock { 1; }
dropItems = List.DropItems(list=equalSublistLengths, amount=code_block)
transpose = List.Transpose(lists=dropItems)
code_block_2 = CodeBlock { 0; 1; 2; }
getItemAtIndex = List.GetItemAtIndex(list=transpose, index=code_block_2.out2)
byName = WallType.ByName(name=getItemAtIndex)
getItemAtIndex_2 = List.GetItemAtIndex(list=transpose, index=code_block_2.out0)
element_duplicate = Custom[Element Duplicate](element=byName, name=getItemAtIndex_2)  # package Genius Loci; Duplicates the given element (view, element type).
getItemAtIndex_3 = List.GetItemAtIndex(list=transpose, index=code_block_2.out1)
code_block_3 = CodeBlock { 0; }
o_systemfamilytype = Orchid.RevitProject.Elements.SystemFamilyType.SetCompoundLayerWidth(elementType=element_duplicate, thickness=getItemAtIndex_3, index=code_block_3, lacing=Longest)
