# Dynamo graph Creating window types_script.dyn (Dynamo 2.10.1.3976)
# packages: Data-Shapes 2022.2.103, Clockwork for Dynamo 1.x 1.34.0

file_path = Filename(".\Family sizes.xlsx")  # graph input
filepath_data = Custom[FilePath Data](DefaulPath=file_path)  # package Data-Shapes; Create filepath input for UI.MultipleInputForm ++ . Check out www.data-shapes.net for more infos !
boolean = BoolSelector(true)
multipleinputform = Custom[MultipleInputForm ++](Inputs=filepath_data, Toggle=boolean)  # package Data-Shapes; Create a form with multiple inputs. see www.data-shapes.net for tutorials and infos!
file_from_path = FileObject(path=multipleinputform.User_Inputs)

# group: Door
string = StringInput("window")
importExcel = Data.ImportExcel(file=file_from_path, sheetName=string)
code_block = CodeBlock { 1; }
code_block_2 = CodeBlock { 0; 1; 2; 3; }
code_block_3 = CodeBlock { "Width"; "Height"; }

equalSublistLengths = Custom[List.EqualSublistLengths](lists=importExcel)  # package Clockwork for Dynamo 1.x; Trims all given lists to the length of the shortest list

# group (continued): Door
dropItems = List.DropItems(list=equalSublistLengths, amount=code_block)
transpose = List.Transpose(lists=dropItems)
getItemAtIndex = List.GetItemAtIndex(list=transpose, index=code_block_2.out3)
byName = FamilyType.ByName(name=getItemAtIndex)
getItemAtIndex_2 = List.GetItemAtIndex(list=transpose, index=code_block_2.out2)
duplicate = Custom[FamilyType.Duplicate](elementType=byName, name=getItemAtIndex_2, lacing=Longest)  # package Clockwork for Dynamo 1.x; Duplicates a family type
getItemAtIndex_3 = List.GetItemAtIndex(list=transpose, index=code_block_2.out1)
setParameterByName = Element.SetParameterByName(element=duplicate, parameterName=code_block_3.out1, value=getItemAtIndex_3)
getItemAtIndex_4 = List.GetItemAtIndex(list=transpose, index=code_block_2.out0)
setParameterByName_2 = Element.SetParameterByName(element=duplicate, parameterName=code_block_3.out0, value=getItemAtIndex_4)
