# Dynamo graph generating 3d doors_script.dyn (Dynamo 2.10.1.3976)
# packages: spring nodes 210.1.1, Clockwork for Dynamo 1.x 1.34.0, Data-Shapes 2022.2.103, Orchid 2.6.7.6065, WombatDynamo 2.3.5

code_block = CodeBlock {  }
element_types = ElementTypes("Wall")
all_elements_of_type = ElementsOfType(element_type=element_types)
getLocation = Element.GetLocation(element=all_elements_of_type)
list_create = List.Create(item0=getLocation)
file_path = Filename("..\..\..\..\..\..\..\..\Desktop\Input Data (1).xlsx")  # graph input
filepath_data = Custom[FilePath Data](DefaulPath=file_path)  # package Data-Shapes; Create filepath input for UI.MultipleInputForm ++ . Check out www.data-shapes.net for more infos !
boolean = BoolSelector(true)
multipleinputform = Custom[MultipleInputForm ++](Inputs=filepath_data, Toggle=boolean)  # package Data-Shapes; Create a form with multiple inputs. see www.data-shapes.net for tutorials and infos!
file_from_path = FileObject(path=multipleinputform.User_Inputs)

# group: Doors
string = StringInput("door")
importExcel = Data.ImportExcel(file=file_from_path, sheetName=string)
code_block_2 = CodeBlock { 1; }

equalSublistLengths = Custom[List.EqualSublistLengths](lists=importExcel)  # package Clockwork for Dynamo 1.x; Trims all given lists to the length of the shortest list

# group (continued): Doors
dropItems = List.DropItems(list=equalSublistLengths, amount=code_block_2)
transpose = List.Transpose(lists=dropItems)

o_list_clean = Orchid.Common.List.Clean(list=transpose)
code_block_3 = CodeBlock(a=o_list_clean)
# ---------- code_block_3.designscript (5 lines) ----------
List.GetItemAtIndex(a[],0);
List.GetItemAtIndex(a[],1);
List.GetItemAtIndex(a[],2);
List.GetItemAtIndex(a[],3);
List.GetItemAtIndex(a[],4);
# ----------------------------------------
byCoordinates = Point.ByCoordinates(x=code_block_3.out0, y=code_block_3.out1)
closestPointTo = Geometry.ClosestPointTo(geometry=list_create, other=byCoordinates@L1)
deconstruct = WombatDynamo.Point.Deconstruct(point=closestPointTo)
byCoordinates_2 = Point.ByCoordinates(x=deconstruct.X, y=deconstruct.Y)
isAlmostEqualTo = Geometry.IsAlmostEqualTo(geometry=byCoordinates_2, other=byCoordinates@L2)
boolean_2 = BoolSelector(true)
indexOf = List.IndexOf(list=isAlmostEqualTo, element=boolean_2@L2)
flatten = List.Flatten(list=indexOf)
getItemAtIndex = List.GetItemAtIndex(list=all_elements_of_type, index=flatten)

# group (continued): Doors
string_from_object = FromObject(obj=code_block_3.out4)
byName = FamilyType.ByName(name=string_from_object)
byCoordinates_3 = Point.ByCoordinates(x=code_block_3.out0, y=code_block_3.out1, z=code_block_3.out2)
ꟿ_familyinstance_byhostandpoint = Custom[ꟿ FamilyInstance.ByHostAndPoint](host=getItemAtIndex, type=byName, point=byCoordinates_3)  # package spring nodes; Creates hosted family instances(doors/windows) at the specified points. You can feed either a single family type or a unique type for each instance.

list_create_2 = List.Create(item0=byCoordinates_3)
