# Dynamo graph WallCreation_script.dyn (Dynamo 2.10.1.3976)
# packages: Data-Shapes 2022.2.103, Clockwork for Dynamo 1.x 1.34.0, Genius Loci 2021.11.10

# group: Wall
file_path = Filename(".\Input Data.xlsx")  # graph input
string = StringInput("wall")
code_block = CodeBlock { 1; }
code_block_2 = CodeBlock { 0; 1; 2; 3; 4; 5; 6; 7; 8; 9; 10; }

filepath_data = Custom[FilePath Data](DefaulPath=file_path)  # package Data-Shapes; Create filepath input for UI.MultipleInputForm ++ . Check out www.data-shapes.net for more infos !
boolean = BoolSelector(true)
multipleinputform = Custom[MultipleInputForm ++](Inputs=filepath_data, Toggle=boolean)  # package Data-Shapes; Create a form with multiple inputs. see www.data-shapes.net for tutorials and infos!

# group (continued): Wall
file_from_path = FileObject(path=multipleinputform.User_Inputs)
importExcel = Data.ImportExcel(file=file_from_path, sheetName=string)

list_clean = Custom[List Clean](list=importExcel)  # package Genius Loci; Removes all Null, Empty and Blank from a list or nested list of lists.
equalSublistLengths = Custom[List.EqualSublistLengths](lists=list_clean)  # package Clockwork for Dynamo 1.x; Trims all given lists to the length of the shortest list

# group (continued): Wall
dropItems = List.DropItems(list=equalSublistLengths, amount=code_block)
transpose = List.Transpose(lists=dropItems)
getItemAtIndex = List.GetItemAtIndex(list=transpose, index=code_block_2.out0)
getItemAtIndex_2 = List.GetItemAtIndex(list=transpose, index=code_block_2.out1)
byCoordinates = Point.ByCoordinates(x=getItemAtIndex, y=getItemAtIndex_2)
getItemAtIndex_3 = List.GetItemAtIndex(list=transpose, index=code_block_2.out2)
getItemAtIndex_4 = List.GetItemAtIndex(list=transpose, index=code_block_2.out3)
byCoordinates_2 = Point.ByCoordinates(x=getItemAtIndex_3, y=getItemAtIndex_4)
byStartPointEndPoint = Line.ByStartPointEndPoint(startPoint=byCoordinates, endPoint=byCoordinates_2)
getItemAtIndex_5 = List.GetItemAtIndex(list=transpose, index=code_block_2.out4)
getItemAtIndex_6 = List.GetItemAtIndex(list=transpose, index=code_block_2.out7)
getItemAtIndex_7 = List.GetItemAtIndex(list=transpose, index=code_block_2.out5)
byElevationAndName = Level.ByElevationAndName(elevation=getItemAtIndex_6, name=getItemAtIndex_7)
getItemAtIndex_8 = List.GetItemAtIndex(list=transpose, index=code_block_2.out6)
string_from_object = FromObject(object=getItemAtIndex_8)
byName = WallType.ByName(name=string_from_object)
byCurveAndHeight = Wall.ByCurveAndHeight(curve=byStartPointEndPoint, height=getItemAtIndex_5, level=byElevationAndName, wallType=byName)

code_block_3 = CodeBlock {  }
