# Dynamo graph Creating Grids_script.dyn (Dynamo 2.10.1.3976)
# packages: Clockwork for Dynamo 1.x 1.34.0, WombatDynamo 2.3.5, Orchid 2.6.7.6065

# group: Grids
element_types = ElementTypes("Wall")
all_elements_of_type = ElementsOfType(element_type=element_types)
orientation = Custom[Wall.Orientation](wall=all_elements_of_type)  # package Clockwork for Dynamo 1.x; Gets the orientation of a given wall instance (normal of the exterior face of the wall). Will *not* work for walls hosted on mass faces or in-place walls.
X = Vector.X(vector=orientation)
string = StringInput("Name")
grid_start_character = StringInput("A")
grid_start_number = DoubleInput(1)

mul = X * X
sqrt = Math.Sqrt(number=mul)
code_block = CodeBlock { 1; }
round = Math.Round(number=sqrt, digits=code_block)
o_number_isalmostzero = Orchid.Common.Number.IsAlmostZero(number=round)

# group (continued): Grids
filterByBoolMask = List.FilterByBoolMask(list=all_elements_of_type, mask=o_number_isalmostzero)
getLocation = Element.GetLocation(element=filterByBoolMask.out)
getLocation_2 = Element.GetLocation(element=filterByBoolMask.in)

startPoint = Curve.StartPoint(curve=getLocation)
string_2 = StringInput("Columns")
byName = Category.ByName(name=string_2)
all_elements_of_category = ElementsOfCategory(Category=byName)
getLocation_3 = Element.GetLocation(element=all_elements_of_category)
list_create = List.Create(item0=startPoint, item1=getLocation_3)
flatten = List.Flatten(list=list_create)
deconstruct = WombatDynamo.Point.Deconstruct(point=flatten)
flatten_2 = List.Flatten(list=deconstruct.X)
code_block_2 = CodeBlock { 0; 1; }
gt = flatten_2 > code_block_2.out0
filterByBoolMask_2 = List.FilterByBoolMask(list=flatten_2, mask=gt)
o_list_sortnatural = Orchid.Common.List.SortNatural(list=filterByBoolMask_2.out, descending=code_block_2.out1)
o_list_sortnatural_2 = Orchid.Common.List.SortNatural(list=filterByBoolMask_2.in)
list_create_2 = List.Create(item0=o_list_sortnatural, item1=o_list_sortnatural_2)
flatten_3 = List.Flatten(list=list_create_2)
indexOf = List.IndexOf(list=flatten_2, element=flatten_3)
getItemAtIndex = List.GetItemAtIndex(list=flatten, index=indexOf)
deconstruct_2 = WombatDynamo.Point.Deconstruct(point=getItemAtIndex)
flatten_4 = List.Flatten(list=deconstruct.Y)
code_block_3 = CodeBlock { 0; 1; }
gt_2 = flatten_4 > code_block_3.out0
filterByBoolMask_3 = List.FilterByBoolMask(list=flatten_4, mask=gt_2)
o_list_sortnatural_3 = Orchid.Common.List.SortNatural(list=filterByBoolMask_3.out, descending=code_block_3.out1)
o_list_sortnatural_4 = Orchid.Common.List.SortNatural(list=filterByBoolMask_3.in)
list_create_3 = List.Create(item0=o_list_sortnatural_3, item1=o_list_sortnatural_4)
flatten_5 = List.Flatten(list=list_create_3)
code_block_4 = CodeBlock(x=flatten_5) { List.GetItemAtIndex(x[],0); }
byCoordinates = Point.ByCoordinates(x=deconstruct_2.X, y=code_block_4, z=deconstruct_2.Z)
code_block_5 = CodeBlock { 500; }
pruneDuplicates = Point.PruneDuplicates(points=byCoordinates, tolerance=code_block_5)
endPoint = Curve.EndPoint(curve=getLocation)
list_create_4 = List.Create(item0=endPoint, item1=getLocation_3)
flatten_6 = List.Flatten(list=list_create_4)
getItemAtIndex_2 = List.GetItemAtIndex(list=flatten_6, index=indexOf)
deconstruct_3 = WombatDynamo.Point.Deconstruct(point=getItemAtIndex_2)
endPoint_2 = Curve.EndPoint(curve=getLocation_2)
getLocation_4 = Element.GetLocation(element=all_elements_of_category)
list_create_5 = List.Create(item0=endPoint_2, item1=getLocation_4)
flatten_7 = List.Flatten(list=list_create_5)
startPoint_2 = Curve.StartPoint(curve=getLocation_2)
list_create_6 = List.Create(item0=startPoint_2, item1=getLocation_4)
flatten_8 = List.Flatten(list=list_create_6)
deconstruct_4 = WombatDynamo.Point.Deconstruct(point=flatten_8)
flatten_9 = List.Flatten(list=deconstruct_4.Y)
code_block_6 = CodeBlock { 0; 1; }
gt_3 = flatten_9 > code_block_6.out0
filterByBoolMask_4 = List.FilterByBoolMask(list=flatten_9, mask=gt_3)
o_list_sortnatural_5 = Orchid.Common.List.SortNatural(list=filterByBoolMask_4.out, descending=code_block_6.out1)
o_list_sortnatural_6 = Orchid.Common.List.SortNatural(list=filterByBoolMask_4.in)
list_create_7 = List.Create(item0=o_list_sortnatural_5, item1=o_list_sortnatural_6)
flatten_10 = List.Flatten(list=list_create_7)
indexOf_2 = List.IndexOf(list=flatten_9, element=flatten_10)
getItemAtIndex_3 = List.GetItemAtIndex(list=flatten_7, index=indexOf_2)
deconstruct_5 = WombatDynamo.Point.Deconstruct(point=getItemAtIndex_3)
lastItem = List.LastItem(list=deconstruct_5.Y)
byCoordinates_2 = Point.ByCoordinates(x=deconstruct_3.X, y=lastItem, z=deconstruct_3.Z)
indexOf_3 = List.IndexOf(list=byCoordinates, element=pruneDuplicates)
getItemAtIndex_4 = List.GetItemAtIndex(list=byCoordinates_2, index=indexOf_3)
byStartPointEndPoint = Line.ByStartPointEndPoint(startPoint=pruneDuplicates, endPoint=getItemAtIndex_4)
number = DoubleInput(3000)
extendStart = Curve.ExtendStart(curve=byStartPointEndPoint, distance=number)
extendEnd = Curve.ExtendEnd(curve=extendStart, distance=number)

# group (continued): Grids
byLine = Grid.ByLine(line=extendEnd)
count = List.Count(list=byLine)
code_block_7 = CodeBlock(start_character=grid_start_character, total=count) { start_character..#total..1; }
string_from_object = FromObject(object=code_block_7)
setParameterByName = Element.SetParameterByName(element=byLine, parameterName=string, value=string_from_object)

firstItem = List.FirstItem(list=flatten_3)
getItemAtIndex_5 = List.GetItemAtIndex(list=flatten_8, index=indexOf_2)
deconstruct_6 = WombatDynamo.Point.Deconstruct(point=getItemAtIndex_5)
byCoordinates_3 = Point.ByCoordinates(x=firstItem, y=deconstruct_6.Y, z=deconstruct_6.Z)
code_block_8 = CodeBlock { 500; }
pruneDuplicates_2 = Point.PruneDuplicates(points=byCoordinates_3, tolerance=code_block_8)
code_block_9 = CodeBlock { 0; 1; }
gt_4 = deconstruct_5.X > code_block_9.out0
filterByBoolMask_5 = List.FilterByBoolMask(list=deconstruct_5.X, mask=gt_4)
o_list_sortnatural_7 = Orchid.Common.List.SortNatural(list=filterByBoolMask_5.in, descending=code_block_9.out1)
o_list_sortnatural_8 = Orchid.Common.List.SortNatural(list=filterByBoolMask_5.out)
list_create_8 = List.Create(item0=o_list_sortnatural_7, item1=o_list_sortnatural_8)
flatten_11 = List.Flatten(list=list_create_8)
code_block_10 = CodeBlock(x=flatten_11) { List.GetItemAtIndex(x[],0); }
byCoordinates_4 = Point.ByCoordinates(x=code_block_10, y=deconstruct_5.Y, z=deconstruct_5.Z)
indexOf_4 = List.IndexOf(list=byCoordinates_3, element=pruneDuplicates_2)
getItemAtIndex_6 = List.GetItemAtIndex(list=byCoordinates_4, index=indexOf_4)
byStartPointEndPoint_2 = Line.ByStartPointEndPoint(startPoint=pruneDuplicates_2, endPoint=getItemAtIndex_6)
number_2 = DoubleInput(3000)
extendStart_2 = Curve.ExtendStart(curve=byStartPointEndPoint_2, distance=number_2)
extendEnd_2 = Curve.ExtendEnd(curve=extendStart_2, distance=number_2)

# group (continued): Grids
byLine_2 = Grid.ByLine(line=extendEnd_2)
count_2 = List.Count(list=byLine_2)
code_block_11 = CodeBlock(start_number=grid_start_number, total=count_2) { start_number..#total..1; }
string_from_object_2 = FromObject(object=code_block_11)
setParameterByName_2 = Element.SetParameterByName(element=byLine_2, parameterName=string, value=string_from_object_2)

boolean = BoolSelector(true)
flatten_12 = List.Flatten(list=deconstruct_4.X)
