# Dynamo graph visualization_columns_script.dyn (Dynamo 2.10.1.3976)
# packages: Crumple 2021.9.24, Clockwork for Dynamo 1.x 1.34.0, Orchid 2.6.7.6065, Data-Shapes 2022.2.103, Quasar 2.1.3, WombatDynamo 2.3.5, Rhythm 2021.6.1

all_elements_in_active_view = ElementsInView()
code_block = CodeBlock { "Columns"; }
byName = Category.ByName(name=code_block)
all_elements_of_category = ElementsOfCategory(Category=byName)
getLinkDocument = Custom[GetLinkDocument]()  # package Quasar; Get all link document. Each list contains , [0] Name of Link Document (String) [1] Link Document (Document)
code_block_2 = CodeBlock(list=getLinkDocument) { list[0][1]; }

# group: Grids
code_block_3 = CodeBlock { "Grids"; }
byName_2 = Category.ByName(name=code_block_3)
all_elements_of_category_2 = ElementsOfCategory(Category=byName_2)
name = Element.Name(element=all_elements_of_category_2)
curve = Grid.Curve(grid=all_elements_of_category_2)
direction = Line.Direction(line=curve)
YAxis = Vector.YAxis()
isParallel = Vector.IsParallel(vector=direction, other=YAxis)
filterByBoolMask = List.FilterByBoolMask(list=name, mask=isParallel)
add = filterByBoolMask.in + filterByBoolMask.out  # lacing=CrossProduct
flatten = List.Flatten(list=add)
boolean = BoolSelector(false)
filterByBoolMask_2 = List.FilterByBoolMask(list=curve, mask=isParallel)
intersect = Geometry.Intersect(geometry=filterByBoolMask_2.in, other=filterByBoolMask_2.out, lacing=CrossProduct)
code_block_4 = CodeBlock { "0"; 10000000; -10000000; }
byCoordinates = Point.ByCoordinates(x=code_block_4.out1, y=code_block_4.out2)
replaceEmptyLists = Custom[List.ReplaceEmptyLists](seq=intersect, Replacement=byCoordinates, lacing=Longest)  # package Clockwork for Dynamo 1.x; Replaces all empty lists within a given list with a substitute
flatten_2 = List.Flatten(list=replaceEmptyLists)
code_block_5 = CodeBlock(pt=flatten_2) { pt.X; pt.Y; }
byCoordinates_2 = Point.ByCoordinates(x=code_block_5.out0, y=code_block_5.out1, lacing=Longest)

# group: Columns
setIntersection = List.SetIntersection(list1=all_elements_in_active_view, list2=all_elements_of_category)
modelComparison = Custom[ModificationTracker.ModelComparison](PreviousVersionDocument=code_block_2, Categories=byName)  # package Data-Shapes; Compares elements from documents A and B (A is the current document by default) and returns existing elements data, new elements, deleted elements and a report. Check out www.Data-Shapes.net for more infos.
code_block_6 = CodeBlock(x=modelComparison.ExistingElements_Data) { List.GetItemAtIndex(x[],0); List.GetItemAtIndex(x[],1); }
watch = Watch(setIntersection)
setIntersection_2 = List.SetIntersection(list1=code_block_6.out0, list2=watch)
elementcentroid = Custom[© ElementCentroid](element=setIntersection_2)  # package Crumple; Returns the centroid of the element's axis-aligned bounding box.
o_list_filterbynullmask = Orchid.Common.List.FilterByNullMask(list=setIntersection, mask=elementcentroid)
clean = List.Clean(list=elementcentroid, preserveIndices=boolean)
code_block_7 = CodeBlock(pt=clean) { pt.X; pt.Y; }
byCoordinates_3 = Point.ByCoordinates(x=code_block_7.out0, y=code_block_7.out1, lacing=Longest)
distanceTo = Geometry.DistanceTo(geometry=byCoordinates_3@L1, other=byCoordinates_2@L2, lacing=Longest)
sortIndexByValue = List.SortIndexByValue(list=distanceTo@L2)
firstItem = List.FirstItem(list=sortIndexByValue@L2)
getItemAtIndex = List.GetItemAtIndex(list=flatten, index=firstItem)
sort = List.Sort(list=distanceTo)
firstItem_2 = List.FirstItem(list=sort@L2)
allChanges = Custom[ModificationTracker.AllChanges](ExistingElementsData=modelComparison.ExistingElements_Data)  # package Data-Shapes; Takes ExistingElements Data as input and outputs lists with all geometry/parameter values change combinations . Check out www.Data-Shapes.net for more informations .
setIntersection_3 = List.SetIntersection(list1=allChanges.Different_geometry_same_parameter_values, list2=watch)
setDifference = List.SetDifference(list1=setIntersection_2, list2=setIntersection_3)

number_slider = DoubleSlider(2, range=0..100 step 0.1)
number_slider_2 = DoubleSlider(2, range=0..100 step 0.1)
round = Math.Round(number=firstItem_2, digits=number_slider_2)

# group: Unchanged Model
elements = Watch(setIntersection_2)
closest_grid = Watch(getItemAtIndex)
distance_to_grid = Watch(round)

count = List.Count(list=modelComparison.New_elements)
count_2 = List.Count(list=modelComparison.Deleted_elements)
code_block_8 = CodeBlock { "--"; "Moved"; }
code_block_9 = CodeBlock()
# ---------- code_block_9.designscript (5 lines) ----------
Red   = Color.ByARGB(255,255,0,0);
Green = Color.ByARGB(255,0,255,0);
Blue  = Color.ByARGB(255,0,0,255);
Color.ByARGB(0,0,0,0);
Color.ByARGB(0,0,0,0);
# ----------------------------------------
deleted = Element.OverrideColorInView(element=modelComparison.New_elements, color=code_block_9.Green)
no_change = Element.OverrideColorInView(color=code_block_9.Blue)  # unwired: element

# group: Export
file_path = Filename("..\export\exported data.xlsx")  # frozen
code_block_10 = CodeBlock { "Result"; 0; }
code_block_11 = CodeBlock()
# ---------- code_block_11.designscript (15 lines) ----------
" ";
"As Designed";
"Element Name";
"Corresponding Grid";
"Distance to Grid(mm)";
"As Built";
"Status";
"Delta Coord";
"Delta W";
"Delta H";
"Accuracy(5 cm)";
"Accuracy(10 cm)";
"Accuracy(20 cm)";
"Completeness";
"Correctness";
# ----------------------------------------
list_create = List.Create(item0=code_block_11.out0, item1=code_block_11.out2, item2=elements, item3=code_block_11.out10, item4=code_block_11.out11, item5=code_block_11.out12, item6=code_block_11.out13, item7=code_block_11.out14)
flatten_3 = List.Flatten(list=list_create)
list_create_2 = List.Create(item0=code_block_11.out0, item1=code_block_11.out4, item2=distance_to_grid)
flatten_4 = List.Flatten(list=list_create_2)
boolean_2 = BoolSelector(true)
string = StringInput("Select the path for .csv file")
file_path_2 = Filename("..\export\exported data.xlsx")
filepath_data = Custom[FilePath Data](DefaulPath=file_path_2)  # package Data-Shapes; Create filepath input for UI.MultipleInputForm ++ . Check out www.data-shapes.net for more infos !
boolean_3 = BoolSelector(true)
multipleinputform = Custom[MultipleInputForm ++](Description_optional=string, Inputs=filepath_data, Toggle=boolean_3)  # package Data-Shapes; Create a form with multiple inputs. see www.data-shapes.net for tutorials and infos!

# group: Visualization
code_block_12 = CodeBlock { 50; 100; 200; }
color_palette = ColorPalette({R: 235, G: 173, B: 173, A: 255})
color_palette_2 = ColorPalette({R: 251, G: 119, B: 119, A: 255})
color_palette_3 = ColorPalette({R: 251, G: 68, B: 65, A: 255})
color_palette_4 = ColorPalette({R: 251, G: 4, B: 4, A: 255})
list_create_3 = List.Create(item0=color_palette, item1=color_palette_2, item2=color_palette_3, item3=color_palette_4)
code_block_13 = CodeBlock { 0; 1; -1..1; }
color_palette_5 = ColorPalette({R: 100, G: 149, B: 237, A: 255})

# group: Moved Columns
setIntersection_4 = List.SetIntersection(list1=code_block_6.out1, list2=watch)
elementcentroid_2 = Custom[© ElementCentroid](element=setIntersection_4)
clean_2 = List.Clean(list=elementcentroid_2, preserveIndices=boolean)
code_block_14 = CodeBlock(pt=clean_2) { pt.X; pt.Y; }
byCoordinates_4 = Point.ByCoordinates(x=code_block_14.out0, y=code_block_14.out1, lacing=Longest)
byCoordinates_5 = Point.ByCoordinates(x=code_block_5.out0, y=code_block_5.out1, lacing=Longest)
flatten_5 = List.Flatten(list=add)

# group: Changed Model
closest_grid_2 = Watch(getItemAtIndex)
elements_2 = Watch(setIntersection_4)

# group (continued): Moved Columns
indexOf = List.IndexOf(list=flatten_5, element=closest_grid_2)
getItemAtIndex_2 = List.GetItemAtIndex(list=byCoordinates_5, index=indexOf)
distanceTo_2 = Geometry.DistanceTo(geometry=byCoordinates_4, other=getItemAtIndex_2)

round_2 = Math.Round(number=distanceTo_2, digits=number_slider)

# group (continued): Changed Model
distance_to_grid_2 = Watch(round_2)

# group (continued): Visualization
sub = distance_to_grid_2 - distance_to_grid
mul = sub * sub
sqrt = Math.Sqrt(number=mul)
o_number_isalmostzero = Orchid.Common.Number.IsAlmostZero(number=sqrt)
filterByBoolMask_3 = List.FilterByBoolMask(list=sqrt, mask=o_number_isalmostzero)
lt = code_block_12.out0 < filterByBoolMask_3.out
countTrue = List.CountTrue(list=lt)
o_number_isalmostzero_2 = Orchid.Common.Number.IsAlmostZero(number=sub)
filterByBoolMask_4 = List.FilterByBoolMask(list=sqrt, mask=o_number_isalmostzero_2)
count_3 = List.Count(list=filterByBoolMask_4.in)
add_2 = countTrue + count_3
count_4 = List.Count(list=sqrt)
similarity_5_cm = add_2 / count_4
lt_2 = code_block_12.out1 < filterByBoolMask_3.out
countTrue_2 = List.CountTrue(list=lt_2)
add_3 = countTrue_2 + count_3
similarity_10_cm = add_3 / count_4
lt_3 = code_block_12.out2 < filterByBoolMask_3.out
countTrue_3 = List.CountTrue(list=lt_3)
add_4 = countTrue_3 + count_3
similarity_20_cm = add_4 / count_4
filterByBoolMask_5 = List.FilterByBoolMask(list=elements, mask=o_number_isalmostzero_2)
o_list_sortnatural = Orchid.Common.List.SortNatural(list=filterByBoolMask_4.out)
remapRange = Math.RemapRange(numbers=o_list_sortnatural, newMin=code_block_13.out0, newMax=code_block_13.out1)
color_range = ColorRange(colors=list_create_3, indices=code_block_13.out2, value=remapRange)
changed = Element.OverrideColorInView(element=filterByBoolMask_5.out, color=color_range)
no_change_2 = Element.OverrideColorInView(element=filterByBoolMask_5.in, color=color_palette_5)

accuracy = CodeBlock(x=similarity_5_cm, y=similarity_10_cm, z=similarity_20_cm) { (1-x); (1-y); (1-z); }
count_5 = List.Count(list=elements_2)
add_5 = count_5 + count
code_block_15 = CodeBlock(a=count_5, b=add_5) { a/b; 2; }
completeness = Math.Round(number=code_block_15.out0, digits=code_block_15.out1)
add_6 = count_5 + count_2
code_block_16 = CodeBlock(a=count_5, b=add_6) { a/b; 2; }
correctness = Math.Round(number=code_block_16.out0, digits=code_block_16.out1)

# group (continued): Export
list_create_4 = List.Create(item0=code_block_11.out1, item1=code_block_11.out3, item2=closest_grid, item3=accuracy.out0, item4=accuracy.out1, item5=accuracy.out2, item6=completeness, item7=correctness)
flatten_6 = List.Flatten(list=list_create_4)
list_create_5 = List.Create(item0=code_block_11.out0, item1=code_block_11.out2, item2=elements_2)
flatten_7 = List.Flatten(list=list_create_5)
list_create_6 = List.Create(item0=code_block_11.out5, item1=code_block_11.out3, item2=closest_grid_2)
flatten_8 = List.Flatten(list=list_create_6)
list_create_7 = List.Create(item0=code_block_11.out0, item1=code_block_11.out4, item2=distance_to_grid_2)
flatten_9 = List.Flatten(list=list_create_7)

eq = distance_to_grid_2 == distance_to_grid
filterByBoolMask_6 = List.FilterByBoolMask(list=closest_grid_2, mask=eq)
o_list_replace = Orchid.Common.List.Replace(list=closest_grid_2, searchFor=filterByBoolMask_6.in, replaceWith=code_block_8.out0)
o_list_replace_2 = Orchid.Common.List.Replace(list=o_list_replace, searchFor=filterByBoolMask_6.out, replaceWith=code_block_8.out1)

# group (continued): Export
list_create_8 = List.Create(item0=code_block_11.out0, item1=code_block_11.out6, item2=o_list_replace_2)
flatten_10 = List.Flatten(list=list_create_8)

# group: RMSE
getLocation = Element.GetLocation(element=elements)
deconstruct = WombatDynamo.Point.Deconstruct(point=getLocation)
getLocation_2 = Element.GetLocation(element=elements_2)
deconstruct_2 = WombatDynamo.Point.Deconstruct(point=getLocation_2)
sub_2 = deconstruct.X - deconstruct_2.X
sub_3 = deconstruct.Y - deconstruct_2.Y
elements_3 = Watch(setIntersection_2)
code_block_17 = CodeBlock { "Width"; "Depth"; }
W = Rhythm.Revit.Elements.Elements.GetParameterValueByNameTypeOrInstance(element=elements_3, parameterName=code_block_17.out0)
elements_4 = Watch(setIntersection_4)
code_block_18 = CodeBlock { "Width"; "Depth"; }
w = Rhythm.Revit.Elements.Elements.GetParameterValueByNameTypeOrInstance(element=elements_4, parameterName=code_block_18.out0)
delta_w = W - w
H = Rhythm.Revit.Elements.Elements.GetParameterValueByNameTypeOrInstance(element=elements_3, parameterName=code_block_17.out1)
h = Rhythm.Revit.Elements.Elements.GetParameterValueByNameTypeOrInstance(element=elements_4, parameterName=code_block_18.out1)
delta_h = H - h

mul_2 = sub_2 * sub_2
sqrt_2 = Math.Sqrt(number=mul_2)

# group (continued): RMSE
dx = Math.Round(number=sqrt_2)

mul_3 = dx * dx
mul_4 = sub_3 * sub_3
sqrt_3 = Math.Sqrt(number=mul_4)

# group (continued): RMSE
dy = Math.Round(number=sqrt_3)

mul_5 = dy * dy

# group (continued): RMSE
code_block_19 = CodeBlock(dx=mul_3, dy=mul_5) { dx+dy; }
sqrt_4 = Math.Sqrt(number=code_block_19)
delta_coordinates = Math.Round(number=sqrt_4)

# group (continued): Export
list_create_9 = List.Create(item0=code_block_11.out0, item1=code_block_11.out7, item2=delta_coordinates)
flatten_11 = List.Flatten(list=list_create_9)
list_create_10 = List.Create(item0=code_block_11.out0, item1=code_block_11.out8, item2=delta_w)
flatten_12 = List.Flatten(list=list_create_10)
list_create_11 = List.Create(item0=code_block_11.out0, item1=code_block_11.out9, item2=delta_h)
flatten_13 = List.Flatten(list=list_create_11)
list_create_12 = List.Create(item0=flatten_3, item1=flatten_6, item2=flatten_4, item3=flatten_10, item4=flatten_7, item5=flatten_8, item6=flatten_9, item7=flatten_11, item8=flatten_12, item9=flatten_13)
transpose = List.Transpose(lists=list_create_12)
exportExcel = Data.ExportExcel(filePath=file_path, sheetName=code_block_10.out0, startRow=code_block_10.out1, startCol=code_block_10.out1, data=transpose, overWrite=boolean_2)  # frozen
exportCSV = Data.ExportCSV(filePath=multipleinputform.User_Inputs, data=transpose)

indexOf_2 = List.IndexOf(list=closest_grid_2, element=filterByBoolMask_6.in)
indexOf_3 = List.IndexOf(list=closest_grid_2, element=filterByBoolMask_6.out)
