# Dynamo graph visualization_walls_script.dyn (Dynamo 2.10.1.3976)
# packages: Clockwork for Dynamo 1.x 1.34.0, Data-Shapes 2022.2.103, Quasar 2.1.3, Orchid 2.6.7.6065, WombatDynamo 2.3.5, spring nodes 204.1.0, archi-lab.net 2024.217.1024, Rhythm 2021.6.1

# group: Grids
boolean = BoolSelector(false)
code_block = CodeBlock { "Grids"; }
byName = Category.ByName(name=code_block)
all_elements_of_category = ElementsOfCategory(Category=byName)
curve = Grid.Curve(grid=all_elements_of_category)
direction = Line.Direction(line=curve)
YAxis = Vector.YAxis()
isParallel = Vector.IsParallel(vector=direction, other=YAxis)
filterByBoolMask = List.FilterByBoolMask(list=curve, mask=isParallel)
intersect = Geometry.Intersect(geometry=filterByBoolMask.in, other=filterByBoolMask.out, lacing=CrossProduct)
code_block_2 = CodeBlock { "0"; 10000000; -10000000; }
byCoordinates = Point.ByCoordinates(x=code_block_2.out1, y=code_block_2.out2)
replaceEmptyLists = Custom[List.ReplaceEmptyLists](seq=intersect, Replacement=byCoordinates, lacing=Longest)  # package Clockwork for Dynamo 1.x; Replaces all empty lists within a given list with a substitute
flatten = List.Flatten(list=replaceEmptyLists)
code_block_3 = CodeBlock(pt=flatten) { pt.X; pt.Y; }
byCoordinates_2 = Point.ByCoordinates(x=code_block_3.out0, y=code_block_3.out1, lacing=Longest)
name = Element.Name(element=all_elements_of_category)
filterByBoolMask_2 = List.FilterByBoolMask(list=name, mask=isParallel)
add = filterByBoolMask_2.in + filterByBoolMask_2.out  # lacing=CrossProduct
flatten_2 = List.Flatten(list=add)

getLinkDocument = Custom[GetLinkDocument]()  # package Quasar; Get all link document. Each list contains , [0] Name of Link Document (String) [1] Link Document (Document)
code_block_4 = CodeBlock(list=getLinkDocument) { list[0][1]; }
code_block_5 = CodeBlock { "Walls"; }
byName_2 = Category.ByName(name=code_block_5)
modelComparison = Custom[ModificationTracker.ModelComparison](PreviousVersionDocument=code_block_4, Categories=byName_2)  # package Data-Shapes; Compares elements from documents A and B (A is the current document by default) and returns existing elements data, new elements, deleted elements and a report. Check out www.Data-Shapes.net for more infos.
code_block_6 = CodeBlock(x=modelComparison.ExistingElements_Data) { List.GetItemAtIndex(x[],0); List.GetItemAtIndex(x[],1); }
list_create = List.Create(item0=code_block_6.out0)

# group: Walls as designed
getLocation = Element.GetLocation(element=code_block_6.out0)
endPoint = Curve.EndPoint(curve=getLocation)
code_block_7 = CodeBlock(pt=endPoint) { pt.X; pt.Y; }
byCoordinates_3 = Point.ByCoordinates(x=code_block_7.out0, y=code_block_7.out1, lacing=Longest)
distanceTo = Geometry.DistanceTo(geometry=byCoordinates_3@L1, other=byCoordinates_2@L2, lacing=Longest)
sortIndexByValue = List.SortIndexByValue(list=distanceTo@L2)
firstItem = List.FirstItem(list=sortIndexByValue@L2)
startPoint = Curve.StartPoint(curve=getLocation)
code_block_8 = CodeBlock(pt=startPoint) { pt.X; pt.Y; }
byCoordinates_4 = Point.ByCoordinates(x=code_block_8.out0, y=code_block_8.out1, lacing=Longest)
distanceTo_2 = Geometry.DistanceTo(geometry=byCoordinates_4@L1, other=byCoordinates_2@L2, lacing=Longest)
sortIndexByValue_2 = List.SortIndexByValue(list=distanceTo_2@L2)
firstItem_2 = List.FirstItem(list=sortIndexByValue_2@L2)
getItemAtIndex = List.GetItemAtIndex(list=flatten_2, index=firstItem_2)
start_grid_point = Watch(getItemAtIndex)
getItemAtIndex_2 = List.GetItemAtIndex(list=flatten_2, index=firstItem)
end_grid_points = Watch(getItemAtIndex_2)
grid_points = start_grid_point + end_grid_points
name_2 = FamilyType.Name(familyType=code_block_6.out0)
wall_type = Watch(name_2)
byStartPointEndPoint = Line.ByStartPointEndPoint(startPoint=byCoordinates_4, endPoint=byCoordinates_3)
length = Curve.Length(curve=byStartPointEndPoint)
distance_between_grid_points = Watch(length)

# group: Walls as built
getLocation_2 = Element.GetLocation(element=code_block_6.out1)
endPoint_2 = Curve.EndPoint(curve=getLocation_2)
code_block_9 = CodeBlock(pt=endPoint_2) { pt.X; pt.Y; }
byCoordinates_5 = Point.ByCoordinates(x=code_block_9.out0, y=code_block_9.out1, lacing=Longest)
startPoint_2 = Curve.StartPoint(curve=getLocation_2)
code_block_10 = CodeBlock(pt=startPoint_2) { pt.X; pt.Y; }
byCoordinates_6 = Point.ByCoordinates(x=code_block_10.out0, y=code_block_10.out1, lacing=Longest)
distanceTo_3 = Geometry.DistanceTo(geometry=byCoordinates_5@L1, other=byCoordinates_2@L2, lacing=Longest)
sortIndexByValue_3 = List.SortIndexByValue(list=distanceTo_3@L2)
firstItem_3 = List.FirstItem(list=sortIndexByValue_3@L2)
name_3 = FamilyType.Name(familyType=code_block_6.out1)
wall_type_2 = Watch(name_3)
getItemAtIndex_3 = List.GetItemAtIndex(list=flatten_2, index=firstItem_2)
start_grid_point_2 = Watch(getItemAtIndex_3)
getItemAtIndex_4 = List.GetItemAtIndex(list=flatten_2, index=firstItem)
end_grid_points_2 = Watch(getItemAtIndex_4)
grid_points_2 = start_grid_point_2 + end_grid_points_2
byStartPointEndPoint_2 = Line.ByStartPointEndPoint(startPoint=byCoordinates_6, endPoint=byCoordinates_5)
length_2 = Curve.Length(curve=byStartPointEndPoint_2)
distance_between_grid_points_2 = Watch(length_2)

getItemAtIndex_5 = List.GetItemAtIndex(list=flatten, index=firstItem)
distanceTo_4 = Geometry.DistanceTo(geometry=byCoordinates_5, other=getItemAtIndex_5)
getItemAtIndex_6 = List.GetItemAtIndex(list=flatten, index=firstItem_2)
distanceTo_5 = Geometry.DistanceTo(geometry=byCoordinates_6, other=getItemAtIndex_6)
deconstruct = WombatDynamo.Point.Deconstruct(point=byCoordinates_4)
deconstruct_2 = WombatDynamo.Point.Deconstruct(point=byCoordinates_6)
count = List.Count(list=modelComparison.New_elements)
count_2 = List.Count(list=modelComparison.Deleted_elements)
string = StringInput("QWERTYUIOPLKJHGFDSAZXCVBNM")
string_2 = StringInput("1234567890")
number_slider = DoubleSlider(2, range=0..100 step 0.1)
distanceTo_6 = Geometry.DistanceTo(geometry=byCoordinates_3, other=getItemAtIndex_5)
distanceTo_7 = Geometry.DistanceTo(geometry=byCoordinates_4, other=getItemAtIndex_6)
allChanges = Custom[ModificationTracker.AllChanges](ExistingElementsData=modelComparison.ExistingElements_Data)  # package Data-Shapes; Takes ExistingElements Data as input and outputs lists with all geometry/parameter values change combinations . Check out www.Data-Shapes.net for more informations .
o_string_split = Orchid.Common.String.Split(string=start_grid_point_2, separator=string_2)
o_string_split_2 = Orchid.Common.String.Split(string=start_grid_point_2, separator=string)

# group: Analysis
watch = Watch(code_block_6.out0)
orientation = Custom[Wall.Orientation](wall=watch)  # package Clockwork for Dynamo 1.x; Gets the orientation of a given wall instance (normal of the exterior face of the wall). Will *not* work for walls hosted on mass faces or in-place walls.
X = Vector.X(vector=orientation)
o_number_isalmostzero = Orchid.Common.Number.IsAlmostZero(number=X)
filterByBoolMask_3 = List.FilterByBoolMask(list=watch, mask=o_number_isalmostzero)
list_create_2 = List.Create(item0=filterByBoolMask_3.in, item1=filterByBoolMask_3.out)
flatten_3 = List.Flatten(list=list_create_2)
flatten_4 = List.Flatten(list=list_create)
mul = distanceTo_4 * distanceTo_5
o_number_isalmostzero_2 = Orchid.Common.Number.IsAlmostZero(number=mul)
filterByBoolMask_4 = List.FilterByBoolMask(list=mul, mask=o_number_isalmostzero_2)
indexOf = List.IndexOf(list=mul, element=filterByBoolMask_4.out)
getItemAtIndex_7 = List.GetItemAtIndex(list=flatten_4, index=indexOf)
code_block_11 = CodeBlock { "--"; "Moved"; 0; }
o_list_replace = Orchid.Common.List.Replace(list=flatten_3, searchFor=getItemAtIndex_7, replaceWith=code_block_11.out1)
o_list_replace_2 = Orchid.Common.List.Replace(list=o_list_replace, searchFor=watch, replaceWith=code_block_11.out0)
indexOf_2 = List.IndexOf(list=flatten_3, element=getItemAtIndex_7)
sub = deconstruct.Y - deconstruct_2.Y
code_block_12 = CodeBlock { 3; }
round = Math.Round(number=sub, digits=code_block_12)
ꟿ_number_tostring = Custom[ꟿ Number.ToString](num=round)  # package spring nodes; Converts the input number(s) to string. You can optionally limit the number of digits.
string_3 = StringInput("-")
o_string_split_3 = Orchid.Common.String.Split(string=ꟿ_number_tostring, separator=string_3)
toNumber = String.ToNumber(str=o_string_split_3)
flatten_5 = List.Flatten(list=toNumber)
getItemAtIndex_8 = List.GetItemAtIndex(list=grid_points, index=indexOf)
orientation_2 = Custom[Wall.Orientation](wall=getItemAtIndex_7)
X_2 = Vector.X(vector=orientation_2)
o_number_isalmostzero_3 = Orchid.Common.Number.IsAlmostZero(number=X_2)
filterByBoolMask_5 = List.FilterByBoolMask(list=getItemAtIndex_8, mask=o_number_isalmostzero_3)
indexOf_3 = List.IndexOf(list=grid_points, element=filterByBoolMask_5.in)
getItemAtIndex_9 = List.GetItemAtIndex(list=flatten_5, index=indexOf_3)
sub_2 = deconstruct.X - deconstruct_2.X
round_2 = Math.Round(number=sub_2, digits=code_block_12)
ꟿ_number_tostring_2 = Custom[ꟿ Number.ToString](num=round_2)
o_string_split_4 = Orchid.Common.String.Split(string=ꟿ_number_tostring_2, separator=string_3)
toNumber_2 = String.ToNumber(str=o_string_split_4)
flatten_6 = List.Flatten(list=toNumber_2)
indexOf_4 = List.IndexOf(list=grid_points, element=filterByBoolMask_5.out)
getItemAtIndex_10 = List.GetItemAtIndex(list=flatten_6, index=indexOf_4)
list_create_3 = List.Create(item0=getItemAtIndex_9, item1=getItemAtIndex_10)
flatten_7 = List.Flatten(list=list_create_3)
filterByBoolMask_6 = List.FilterByBoolMask(list=getItemAtIndex_7, mask=o_number_isalmostzero_3)
list_create_4 = List.Create(item0=filterByBoolMask_6.in, item1=filterByBoolMask_6.out)
flatten_8 = List.Flatten(list=list_create_4)
indexOf_5 = List.IndexOf(list=flatten_8, element=getItemAtIndex_7)
getItemAtIndex_11 = List.GetItemAtIndex(list=flatten_7, index=indexOf_5)
clean = List.Clean(list=getItemAtIndex_11)
o_number_isalmostzero_4 = Orchid.Common.Number.IsAlmostZero(number=clean)
filterByBoolMask_7 = List.FilterByBoolMask(list=clean, mask=o_number_isalmostzero_4)
indexOf_6 = List.IndexOf(list=clean, element=filterByBoolMask_7.out)
getItemAtIndex_12 = List.GetItemAtIndex(list=clean, index=indexOf_6)
distance_to_grid = Watch(getItemAtIndex_12)
replaceItemAtIndex = archilab.Lists.Lists.ReplaceItemAtIndex(list=flatten_3, index=indexOf_2, item=distance_to_grid)
o_list_replace_3 = Orchid.Common.List.Replace(list=replaceItemAtIndex, searchFor=flatten_3, replaceWith=code_block_11.out2)
indexOf_7 = List.IndexOf(list=watch, element=filterByBoolMask_3.in)
getItemAtIndex_13 = List.GetItemAtIndex(list=end_grid_points, index=indexOf_7)
o_string_split_5 = Orchid.Common.String.Split(string=getItemAtIndex_13, separator=string)
flatten_9 = List.Flatten(list=o_string_split_5)
indexOf_8 = List.IndexOf(list=watch, element=filterByBoolMask_3.out)
getItemAtIndex_14 = List.GetItemAtIndex(list=end_grid_points, index=indexOf_8)
o_string_split_6 = Orchid.Common.String.Split(string=getItemAtIndex_14, separator=string_2)
flatten_10 = List.Flatten(list=o_string_split_6)
list_create_5 = List.Create(item0=flatten_9, item1=flatten_10)
flatten_11 = List.Flatten(list=list_create_5)
indexOf_9 = List.IndexOf(list=watch, element=flatten_3)
getItemAtIndex_15 = List.GetItemAtIndex(list=code_block_6.out1, index=indexOf_9)
flatten_12 = List.Flatten(list=o_string_split)
getItemAtIndex_16 = List.GetItemAtIndex(list=flatten_12, index=indexOf)
getItemAtIndex_17 = List.GetItemAtIndex(list=getItemAtIndex_7, index=indexOf_6)
wall_moved = Watch(getItemAtIndex_17)
flatten_13 = List.Flatten(list=o_string_split_2)
getItemAtIndex_18 = List.GetItemAtIndex(list=flatten_13, index=indexOf)
filterByBoolMask_8 = List.FilterByBoolMask(list=getItemAtIndex_18, mask=o_number_isalmostzero_3)
getItemAtIndex_19 = List.GetItemAtIndex(list=flatten_13, index=indexOf_3)
getItemAtIndex_20 = List.GetItemAtIndex(list=flatten_12, index=indexOf_4)
list_create_6 = List.Create(item0=getItemAtIndex_19, item1=getItemAtIndex_20)
flatten_14 = List.Flatten(list=list_create_6)
getItemAtIndex_21 = List.GetItemAtIndex(list=flatten_14, index=indexOf_5)
getItemAtIndex_22 = List.GetItemAtIndex(list=getItemAtIndex_21, index=indexOf_6)
corresponding_grid = Watch(getItemAtIndex_22)

round_3 = Math.Round(number=o_list_replace_3, digits=number_slider)

# group: as designed
watch_2 = Watch(flatten_3)
watch_3 = Watch(o_list_replace_2)
watch_4 = Watch(flatten_11)
watch_5 = Watch(round_3)

name_4 = FamilyType.Name(familyType=watch_2)

# group: RMSE
code_block_13 = CodeBlock { 50; 100; 200; }
delta_coordinates = Watch(o_list_replace_3)
code_block_14 = CodeBlock(a=delta_coordinates) { a*a; }
sqrt = Math.Sqrt(number=code_block_14)
o_number_isalmostzero_5 = Orchid.Common.Number.IsAlmostZero(number=sqrt)
filterByBoolMask_9 = List.FilterByBoolMask(list=sqrt, mask=o_number_isalmostzero_5)
lt = code_block_13.out0 < filterByBoolMask_9.out
countTrue = List.CountTrue(list=lt)
count_3 = List.Count(list=filterByBoolMask_9.in)
add_2 = countTrue + count_3
count_4 = List.Count(list=delta_coordinates)
simi_5_cm = add_2 / count_4
lt_2 = code_block_13.out1 < filterByBoolMask_9.out
countTrue_2 = List.CountTrue(list=lt_2)
add_3 = countTrue_2 + count_3
simi_10_cm = add_3 / count_4
lt_3 = code_block_13.out2 < filterByBoolMask_9.out
countTrue_3 = List.CountTrue(list=lt_3)
add_4 = countTrue_3 + count_3
simi_20_cm = add_4 / count_4
code_block_15 = CodeBlock { "Width"; }
W = Rhythm.Revit.Elements.Elements.GetParameterValueByNameTypeOrInstance(element=watch_2, parameterName=code_block_15)
w = Rhythm.Revit.Elements.Elements.GetParameterValueByNameTypeOrInstance(element=getItemAtIndex_15, parameterName=code_block_15)
delta_w = W - w

accuracy = CodeBlock(x=simi_5_cm, y=simi_10_cm, z=simi_20_cm) { (1-x); (1-y); (1-z); }
count_5 = List.Count(list=watch_2)
add_5 = count_5 + count
code_block_16 = CodeBlock(a=count_5, b=add_5) { a/b; 2; }
completeness = Math.Round(number=code_block_16.out0, digits=code_block_16.out1)
add_6 = count_5 + count_2
code_block_17 = CodeBlock(a=count_5, b=add_6) { a/b; 2; }
correctness = Math.Round(number=code_block_17.out0, digits=code_block_17.out1)

# group: Export
file_path = Filename("..\export\exported data.xlsx")
code_block_18 = CodeBlock { "Result"; 0; }
code_block_19 = CodeBlock()
# ---------- code_block_19.designscript (14 lines) ----------
"Element Name";
"Corresponding Grid";
"Distance to Grid(mm)";
"";
"Status";



"Delta W";
"Accuracy(5 cm)";
"Accuracy(10 cm)";
"Accuracy(20 cm)";
"Completeness";
"Correctness";
# ----------------------------------------
list_create_7 = List.Create(item0=code_block_19.out0, item1=name_4, item2=code_block_19.out6, item3=code_block_19.out7, item4=code_block_19.out8, item5=code_block_19.out9, item6=code_block_19.out10)
flatten_15 = List.Flatten(list=list_create_7)
list_create_8 = List.Create(item0=code_block_19.out4, item1=watch_3, item2=accuracy.out0, item3=accuracy.out1, item4=accuracy.out2, item5=completeness, item6=correctness)
flatten_16 = List.Flatten(list=list_create_8)
list_create_9 = List.Create(item0=code_block_19.out1, item1=watch_4)
flatten_17 = List.Flatten(list=list_create_9)
list_create_10 = List.Create(item0=code_block_19.out2, item1=watch_5)
flatten_18 = List.Flatten(list=list_create_10)
list_create_11 = List.Create(item0=code_block_19.out5, item1=delta_w)
flatten_19 = List.Flatten(list=list_create_11)
list_create_12 = List.Create(item0=flatten_15, item1=flatten_16, item2=flatten_17, item3=flatten_18, item4=flatten_19)
transpose = List.Transpose(lists=list_create_12)
boolean_2 = BoolSelector(true)
exportExcel = Data.ExportExcel(filePath=file_path, sheetName=code_block_18.out0, startRow=code_block_18.out1, startCol=code_block_18.out1, data=transpose, overWrite=boolean_2)  # frozen
string_4 = StringInput("Select the path for .csv file")
file_path_2 = Filename("..\export\exported data.xlsx")
filepath_data = Custom[FilePath Data](DefaulPath=file_path_2)  # package Data-Shapes; Create filepath input for UI.MultipleInputForm ++ . Check out www.data-shapes.net for more infos !
boolean_3 = BoolSelector(true)
multipleinputform = Custom[MultipleInputForm ++](Description_optional=string_4, Inputs=filepath_data, Toggle=boolean_3)  # package Data-Shapes; Create a form with multiple inputs. see www.data-shapes.net for tutorials and infos!
exportCSV = Data.ExportCSV(filePath=multipleinputform.User_Inputs, data=transpose)

o_number_isalmostzero_6 = Orchid.Common.Number.IsAlmostZero(number=watch_5)
filterByBoolMask_10 = List.FilterByBoolMask(list=watch_5, mask=o_number_isalmostzero_6)
color_palette = ColorPalette({R: 251, G: 152, B: 152, A: 255})
color_palette_2 = ColorPalette({R: 247, G: 104, B: 104, A: 255})
color_palette_3 = ColorPalette({R: 245, G: 68, B: 68, A: 255})
color_palette_4 = ColorPalette({R: 245, G: 7, B: 7, A: 255})
list_create_13 = List.Create(item0=color_palette, item1=color_palette_2, item2=color_palette_3, item3=color_palette_4)
code_block_20 = CodeBlock { 0; 1; -1..1; }
remapRange = Math.RemapRange(numbers=filterByBoolMask_4.out, newMin=code_block_20.out0, newMax=code_block_20.out1)
color_range = ColorRange(colors=list_create_13, indices=code_block_20.out2, value=remapRange)
changed = Element.OverrideColorInView(element=getItemAtIndex_7, color=color_range)
filterByBoolMask_11 = List.FilterByBoolMask(list=watch_2, mask=o_number_isalmostzero_6)
no_change = Element.OverrideColorInView(element=filterByBoolMask_11.in)  # unwired: color
color_palette_5 = ColorPalette({R: 7, G: 32, B: 245, A: 255})
eq = distance_between_grid_points == distance_between_grid_points_2
